# Grasshopper definition L2_FinishedSlicing_Print2.gh (Grasshopper 1.0.8)

merge = Merge()

# ----
# Input Parameters
base_polygon_number_of_sides = Slider(3, range=0..10)
all_polygons_fillet_radius = Slider(0, range=0..5)
second_polygon_radius = Slider(25, range=0..50)
second_polygon_number_of_sides = Slider(3, range=0..10)
rotation_of_secind_polygon = Slider(45, range=0..359)
third_polygon_radius = Slider(30, range=0..50)
third_polygon_number_of_sides = Slider(6, range=0..10)
third_polygon_height = Slider(50, range=0..100)
fourth_polygon_radius = Slider(35, range=0..50)
fourth_polygon_number_of_sides = Slider(8, range=0..10)
rotation_of_fourth_polygon = Slider(122, range=0..359)
material_thickness = Slider(3.9, range=0..10)
wall_thickness = Slider(-4, range=-10..10)
padding_in_sliced_array = Slider(1, range=0..10)
bounding_box_base_size = Slider(69, range=0..100)
base_polygon_radius = Slider(20, range=0..50)
height_of_second_polygon = Slider(25, range=0..100)
rotation_of_third_polygon = Slider(90, range=0..359)
fourth_polygon_height = Slider(75, range=0..100)

# ----
# Create Bounding Box
panel = Panel("-2")
division = Division(A=bounding_box_base_size, B=panel)
bonding_box_base = Rectangle(Plane=PlaneXY(0, 0, 0), XSize=bounding_box_base_size, YSize=bounding_box_base_size, Radius=0)  # -> Rectangle, Length
position_bounding_box = VectorXYZ(XComponent=division, YComponent=division, ZComponent=0)  # -> Vector, Length
move = Move(Geometry=bonding_box_base.Rectangle, Motion=position_bounding_box.Vector)  # -> Geometry, Transform
bounding_box = BoxRectangle(Rectangle=move.Geometry, Height=fourth_polygon_height)

# ----
# Polygon 4
p4_height = VectorXYZ(XComponent=0, YComponent=0, ZComponent=fourth_polygon_height)  # -> Vector, Length
polygon_4 = Polygon(
    Plane=PlaneXY(0, 0, 0),
    Radius=fourth_polygon_radius,
    Segments=fourth_polygon_number_of_sides,
    FilletRadius=all_polygons_fillet_radius)  # -> Polygon, Length
move_2 = Move(Geometry=polygon_4.Polygon, Motion=p4_height.Vector)  # -> Geometry, Transform
rotate = Rotate(Geometry=move_2.Geometry, Angle=rotation_of_fourth_polygon, Plane=PlaneXY(0, 0, 0))  # -> Geometry, Transform

# ----
# Polygon 2
p2_height = VectorXYZ(XComponent=0, YComponent=0, ZComponent=height_of_second_polygon)  # -> Vector, Length
polygon_2 = Polygon(
    Plane=PlaneXY(0, 0, 0),
    Radius=second_polygon_radius,
    Segments=second_polygon_number_of_sides,
    FilletRadius=all_polygons_fillet_radius)  # -> Polygon, Length
move_3 = Move(Geometry=polygon_2.Polygon, Motion=p2_height.Vector)  # -> Geometry, Transform
rotate_2 = Rotate(Geometry=move_3.Geometry, Angle=rotation_of_secind_polygon, Plane=PlaneXY(0, 0, 0))  # -> Geometry, Transform

# ----
# Polygon 3
p3_height = VectorXYZ(XComponent=0, YComponent=0, ZComponent=third_polygon_height)  # -> Vector, Length
polygon_3 = Polygon(
    Plane=PlaneXY(0, 0, 0),
    Radius=third_polygon_radius,
    Segments=third_polygon_number_of_sides,
    FilletRadius=all_polygons_fillet_radius)  # -> Polygon, Length
move_4 = Move(Geometry=polygon_3.Polygon, Motion=p3_height.Vector)  # -> Geometry, Transform
rotate_3 = Rotate(Geometry=move_4.Geometry, Angle=rotation_of_third_polygon, Plane=PlaneXY(0, 0, 0))  # -> Geometry, Transform

# ----
# Base
base_polygon = Polygon(
    Plane=PlaneXY(0, 0, 0),
    Radius=base_polygon_radius,
    Segments=base_polygon_number_of_sides,
    FilletRadius=all_polygons_fillet_radius)  # -> Polygon, Length
surface = Surface(base_polygon.Polygon)

# ----
# Create 3D Form
loft_p3_p4 = Loft(
    Curves=[rotate_3.Geometry, rotate.Geometry],
    Options={Adjust=False, Closed=False, LoftEnds=0, LoftSimp=0, LoftType=0, Rebuild=10, Refit=0.01})
loft_base_p2 = Loft(
    Curves=[rotate_2.Geometry, base_polygon.Polygon],
    Options={Adjust=False, Closed=False, LoftEnds=0, LoftSimp=0, LoftType=0, Rebuild=10, Refit=0.01})
loft_p2_p3 = Loft(
    Curves=[rotate_3.Geometry, rotate_2.Geometry],
    Options={Adjust=False, Closed=False, LoftEnds=0, LoftSimp=0, LoftType=0, Rebuild=10, Refit=0.01})
entwine = Entwine(Branch00=loft_base_p2, Branch01=loft_p2_p3, Branch02=loft_p3_p4, FlattenInputs=True)  # -> flatten(Result)

# ----
# Create contours, offset curves, and remove offset curve from bottom
panel_2 = Panel("0")
construct_point = ConstructPoint(XCoordinate=panel_2, YCoordinate=panel_2, ZCoordinate=panel_2)
contour = Contour(Shape=entwine, Point=construct_point, Direction=Vector(0, 0, 1), Distance=material_thickness)
offset_curve = OffsetCurve(Curve=contour, Distance=wall_thickness, Corners=1)
trim_tree = TrimTree(Tree=offset_curve, Depth="1")
replace_paths = ReplacePaths(Data=trim_tree, Search="{0;0}", Replace="{2,5}")
merge_2 = Merge(Data1=contour, Data2=replace_paths)

# ----
# Create Grid to Distribute Slices
box_properties = BoxProperties(Box=bounding_box)  # -> Center, Diagonal, Area, Volume, Degeneracy
deconstruct_vector = DeconstructVector(Vector=box_properties.Diagonal)  # -> XComponent, YComponent, ZComponent
addition = Addition(A=deconstruct_vector.YComponent, B=padding_in_sliced_array)
addition_2 = Addition(A=deconstruct_vector.XComponent, B=padding_in_sliced_array)
tree_statistics = TreeStatistics(Tree=contour)  # -> Paths, Length, Count
expression = Expression(x=tree_statistics.Count, Expression="floor(sqrt(x))")
rectangular = Rectangular(Plane=PlaneXY(0, 0, 0), SizeX=addition_2, SizeY=addition, ExtentX=expression, ExtentY=expression)  # -> Cells, graft(Points)
merge_3 = Merge(Data1=rectangular.Points, Data2=rectangular.Points)

# ----
# Arrange Slices on Grid
area = Area(Geometry=merge_2)  # -> Area, Centroid
orient = Orient(Geometry=merge_2, Source=area.Centroid, Target=merge_3)  # -> Geometry, Transform

# ----
# Etch layer number on surface of each slice
tree_statistics_2 = TreeStatistics(Tree=contour)  # -> Paths, Length, Count
point_on_curve = PointOnCurve(orient.Geometry, parameter=0.681)
boundary_surfaces = BoundarySurfaces(Edges=orient.Geometry)
polyline = PolyLine(Vertices=point_on_curve, Closed=False)
series = Series(Start=0, Step="1", Count=tree_statistics_2.Count)  # -> graft(Series)
text_on_surface = TextOnSurface(Text=series, Font="Sans Bold:no Italic:no", Height="2", Depth="0", BaseLine=polyline, BaseSurface=boundary_surfaces)
