# Grasshopper definition L2_Task1.gh (Grasshopper 1.0.8)

merge = Merge()

# ----
# Input Parameters
rotation_of_second_polygon = Slider(0, range=0..359)
third_polygon_radius = Slider(32, range=0..50)
fourth_polygon_number_of_sides = Slider(8, range=0..10)
base_polygon_radius = Slider(16, range=0..50)
base_polygon_number_of_sides = Slider(8, range=0..10)
all_polygons_fillet_radius = Slider(2, range=0..5)
second_polygon_radius = Slider(32, range=0..50)
second_polygon_number_of_sides = Slider(8, range=0..10)
height_of_second_polygon = Slider(70, range=0..100)
third_polygon_number_of_sides = Slider(8, range=0..10)
third_polygon_height = Slider(70, range=0..100)
rotation_of_third_polygon = Slider(0, range=0..359)
fourth_polygon_radius = Slider(16, range=0..50)
fourth_polygon_height = Slider(88, range=0..100)
rotation_of_fourth_polygon = Slider(0, range=0..359)

# ----
# Polygon 4
p4_height = VectorXYZ(XComponent=0, YComponent=0, ZComponent=fourth_polygon_height)  # -> Vector, Length
polygon_4 = Polygon(
    Plane=PlaneXY(0, 0, 0),
    Radius=fourth_polygon_radius,
    Segments=fourth_polygon_number_of_sides,
    FilletRadius=all_polygons_fillet_radius)  # -> Polygon, Length
move = Move(Geometry=polygon_4.Polygon, Motion=p4_height.Vector)  # -> Geometry, Transform
rotate = Rotate(Geometry=move.Geometry, Angle=rotation_of_fourth_polygon, Plane=PlaneXY(0, 0, 0))  # -> Geometry, Transform

# ----
# Polygon 2
p2_height = VectorXYZ(XComponent=0, YComponent=0, ZComponent=height_of_second_polygon)  # -> Vector, Length
polygon_2 = Polygon(
    Plane=PlaneXY(0, 0, 0),
    Radius=second_polygon_radius,
    Segments=second_polygon_number_of_sides,
    FilletRadius=all_polygons_fillet_radius)  # -> Polygon, Length
move_2 = Move(Geometry=polygon_2.Polygon, Motion=p2_height.Vector)  # -> Geometry, Transform
rotate_2 = Rotate(Geometry=move_2.Geometry, Angle=rotation_of_second_polygon, Plane=PlaneXY(0, 0, 0))  # -> Geometry, Transform

# ----
# Polygon 3
p3_height = VectorXYZ(XComponent=0, YComponent=0, ZComponent=third_polygon_height)  # -> Vector, Length
polygon_3 = Polygon(
    Plane=PlaneXY(0, 0, 0),
    Radius=third_polygon_radius,
    Segments=third_polygon_number_of_sides,
    FilletRadius=all_polygons_fillet_radius)  # -> Polygon, Length
move_3 = Move(Geometry=polygon_3.Polygon, Motion=p3_height.Vector)  # -> Geometry, Transform
rotate_3 = Rotate(Geometry=move_3.Geometry, Angle=rotation_of_third_polygon, Plane=PlaneXY(0, 0, 0))  # -> Geometry, Transform

# ----
# Base
base_polygon = Polygon(
    Plane=PlaneXY(0, 0, 0),
    Radius=base_polygon_radius,
    Segments=base_polygon_number_of_sides,
    FilletRadius=all_polygons_fillet_radius)  # -> Polygon, Length
surface = Surface(base_polygon.Polygon)

# ----
# Create 3D Form
loft_p3_p4 = Loft(
    Curves=[rotate_3.Geometry, rotate.Geometry],
    Options={Adjust=False, Closed=False, LoftEnds=0, LoftSimp=0, LoftType=0, Rebuild=10, Refit=0.01})
loft_base_p2 = Loft(
    Curves=[rotate_2.Geometry, base_polygon.Polygon],
    Options={Adjust=False, Closed=False, LoftEnds=0, LoftSimp=0, LoftType=0, Rebuild=10, Refit=0.01})
loft_p2_p3 = Loft(
    Curves=[rotate_3.Geometry, rotate_2.Geometry],
    Options={Adjust=False, Closed=False, LoftEnds=0, LoftSimp=0, LoftType=0, Rebuild=10, Refit=0.01})
entwine = Entwine(Branch00=loft_base_p2, Branch01=loft_p2_p3, Branch02=loft_p3_p4, FlattenInputs=True)  # -> flatten(Result)
